# Grasshopper definition Ribbon.gh (Grasshopper 1.0.8)
# Copyright: ©

cir = Circle(Plane=PlaneXY(0, 0, 0), Radius=1)
number_slider = Slider(12, range=0..100)
len = Length(Curve=cir)
division = Division(A=len, B=number_slider)
offset = OffsetCurve(Curve=cir, Distance=1, Corners=1)
divide = DivideCurve(Curve=cir, Count=number_slider, Kinks=False)  # -> Points, Tangents, Parameters
series = Series(Start=0, Step=division, Count=number_slider)
divide_2 = DivideCurve(Curve=offset, Count=number_slider, Kinks=False)  # -> Points, Tangents, Parameters
ln = Line(StartPoint=divide_2.Points, EndPoint=divide.Points)
midpt = CurveMiddle(Curve=ln)
frame = CurveFrame(Curve=ln, Parameter=Slider(0.5, range=0..1))
deplane = DeconstructPlane(Plane=frame)  # -> Origin, XAxis, YAxis, ZAxis
rot3d = Rotate3D(Geometry=ln, Angle=series, Center=midpt, Axis=deplane.YAxis)  # -> Geometry, Transform
loft_opt = LoftOptions(Closed=Toggle(True), Adjust=Toggle(False), Rebuild=0, Refit=0, Type=Slider(5, range=0..5))
loft = Loft(Curves=rot3d.Geometry, Options=loft_opt)
sdivide = DivideSurface(Surface=loft, UCount=Slider(38, range=0..100), VCount=Slider(45, range=0..100))  # -> Points, Normals, Parameters
srf_cp = SurfaceClosestPoint(Point=sdivide.Points, Surface=loft)  # -> Point, UVPoint, Distance
evalsrf = EvaluateSurface(Surface=loft, Point=srf_cp.UVPoint)  # -> Point, unitize(Normal), UDirection, VDirection, Frame
lng = ListLength(List=evalsrf.Normal)
random = Random(Range="0 to 0.05", Number=lng, Seed=2)
amp = Amplitude(Vector=evalsrf.Normal, Amplitude=random)
move = Move(Geometry=sdivide.Points, Motion=amp)  # -> Geometry, Transform
intcrv = Interpolate(Vertices=move.Geometry, Degree=3, Periodic=False, KnotStyle=0)  # -> flatten(Curve), Length, Domain
cploft = ControlPointLoft(Curves=intcrv.Curve, Degree=5)
