# Grasshopper definition Ribbon_hops.gh (Grasshopper 1.0.8)
# Copyright: ©

pt = Point(Point(0, 0, 0))
subdivisions = GetNumber(Slider(12, range=0..100), AtLeast=1, AtMost=1, Maximum=1.797693135e+308, Minimum=-1.797693135e+308, TreeAccess=False)
offset_radius = GetNumber(Slider(10, range=0..100), AtLeast=1, AtMost=1, Maximum=1.797693135e+308, Minimum=-1.797693135e+308, TreeAccess=False)
center_point = GetPoint(pt, AtLeast=1, AtMost=1, Realtime=True, TreeAccess=False)
inner_radius = GetNumber(Slider(10, range=0..100), AtLeast=1, AtMost=1, Maximum=1.797693135e+308, Minimum=-1.797693135e+308, TreeAccess=False)
cir = Circle(Plane=center_point, Radius=inner_radius)
len = Length(Curve=cir)
divide = DivideCurve(Curve=cir, Count=subdivisions, Kinks=False)  # -> Points, Tangents, Parameters
division = Division(A=len, B=subdivisions)
offset = OffsetCurve(Curve=cir, Distance=offset_radius, Corners=1)
divide_2 = DivideCurve(Curve=offset, Count=subdivisions, Kinks=False)  # -> Points, Tangents, Parameters
series = Series(Start=0, Step=division, Count=subdivisions)
ln = Line(StartPoint=divide_2.Points, EndPoint=divide.Points)
frame = CurveFrame(Curve=ln, Parameter="0.5")
midpt = CurveMiddle(Curve=ln)
deplane = DeconstructPlane(Plane=frame)  # -> Origin, XAxis, YAxis, ZAxis
rot3d = Rotate3D(Geometry=ln, Angle=series, Center=midpt, Axis=deplane.YAxis)  # -> Geometry, Transform
loft_opt = LoftOptions(Closed=Toggle(True), Adjust=Toggle(False), Rebuild=0, Refit=0, Type=Slider(5, range=0..5))
v_count = GetInteger(Slider(45, range=0..100), AtLeast=1, AtMost=1, Maximum=2147483647, Minimum=-2147483648, TreeAccess=False)
u_count = GetInteger(Slider(38, range=0..100), AtLeast=1, AtMost=1, Maximum=2147483647, Minimum=-2147483648, TreeAccess=False)
loft = Loft(Curves=rot3d.Geometry, Options=loft_opt)
sdivide = DivideSurface(Surface=loft, UCount=u_count, VCount=v_count)  # -> Points, Normals, Parameters
srf_cp = SurfaceClosestPoint(Point=sdivide.Points, Surface=loft)  # -> Point, UVPoint, Distance
evalsrf = EvaluateSurface(Surface=loft, Point=srf_cp.UVPoint)  # -> Point, unitize(Normal), UDirection, VDirection, Frame
lng = ListLength(List=evalsrf.Normal)
random = Random(Range="0 to 0.05", Number=lng, Seed=2)
amp = Amplitude(Vector=evalsrf.Normal, Amplitude=random)
move = Move(Geometry=sdivide.Points, Motion=amp)  # -> Geometry, Transform
intcrv = Interpolate(Vertices=move.Geometry, Degree=3, Periodic=False, KnotStyle=0)  # -> flatten(Curve), Length, Domain
cploft = ControlPointLoft(Curves=intcrv.Curve, Degree=5)
context_bake = ContextBake(Content=cploft)
